# Grasshopper definition dev_big.ghx (Grasshopper 1.0.7)

# ---- group: Add Module Path
python = GhPythonScript(PATH="C:\Users\yoshioca\Documents\GH_Gcode")  # -> out, a
# ---------- python: Python ----------
import sys

sys.path.append(PATH)

print(sys.path)
# ---------- end python ----------

# ----
panel = Panel(python.out)
# - Viewer -
panel_2 = Panel("C:\Users\yoshioca\Documents\GH_Gcode\_data_\data_out\2020-05-02_01-18-43.gcode")
panel_3 = Panel("C:\Users\yoshioca\Documents\GH_Gcode\_data_\EB_Daihatsu_seal_ysok_fanuc.gcode")

# ---- group: Export
button = Button()

# ---- group: Export Path
panel_4 = Panel("C:\Users\yoshioca\Documents\GH_Gcode\_data_\data_out\")

# ---- group: Input Polyline
# Dev
# - Polyline to GCode -
crv = Curve([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])

# ---- group: S = 0.04 * F
panel_5 = Panel("0.04")

# ---- group: M4
panel_6 = Panel("50")

# ---- group: F
panel_7 = Panel("1800")

# ---- group: Z_OFFSET
panel_8 = Panel("5")

# ---- group: M4 Stop Time (Sec)
panel_9 = Panel("0.4")

# ---- group: Z_Buffer (Travel)
panel_10 = Panel("2")

# ----
python_2 = GhPythonScript(AMP=panel_5, F=panel_7)  # -> M3
# ---------- python_2: Python ----------
M3 = int(float(F) * float(AMP))
# ---------- end python_2 ----------
panel_11 = Panel(python_2)
preview = CustomPreview(
    Geometry=crv,
    Material={diffuse=RGB(221, 160, 221), emission=RGB(66, 48, 66), shine=0.5, specular=RGB(255, 255, 255), transparency=0})
python_3 = GhPythonScript(PATH=panel_3)  # -> out, MOVE
# ---------- python_3: Python ----------
import rhinoscriptsyntax as rs

from gh_gcode import viewer_big

vv = viewer_big.ViewerBig()
reload(viewer_big)


###


xyzs = vv.gcode_to_array(PATH)
#print(xyzs)
points_ = vv.draw_path(xyzs) 
MOVE = rs.AddPolyline(points_)
# ---------- end python_3 ----------
python_4 = GhPythonScript(
    POLYLINES=crv,
    M3_S_VALUE=panel_11,
    M4_S_VALUE=panel_6,
    F_VALUE=panel_7,
    Z_OFFSET_VALUE=panel_8,
    M4_STOP_TIME=panel_9,
    Z_BUFFER=panel_10,
    EXPORT=button,
    EXPORT_DIR=panel_4)  # -> out, POINTS, DEV; inputs POLYLINES: list
# ---------- python_4: Python ----------
import rhinoscriptsyntax as rs


from gh_gcode import operate_curve, operate_big_gcode, util

gc = operate_curve.Curve()
gg = operate_big_gcode.BigGcode()
ut = util.Util()

reload(operate_curve)
reload(operate_big_gcode)
reload(util)


##########



##########



### Polylines to Points
pts = gc.polylines_to_points(POLYLINES)
POINTS = ut.flatten_runtime_list(pts)


### Z OFFSET
pts_off = gc.offset_z(pts, Z_OFFSET_VALUE)
DEV = ut.flatten_runtime_list(pts_off)


### Points to Gcode
gcode = gg.points_list_to_gcode(pts_off, M3_S_VALUE, M4_S_VALUE, F_VALUE, Z_OFFSET_VALUE, M4_STOP_TIME, Z_BUFFER)



if EXPORT == True:
    ut.export_gcode(EXPORT_DIR, gcode)
# ---------- end python_4 ----------
panel_12 = Panel(python_3.out)
pline = PolyLine(Vertices=python_4.DEV, Closed=False)  # disabled
panel_13 = Panel(python_4.out)
pt = Point(python_4.POINTS)
panel_14 = Panel("C:\Users\yoshioca\Documents\GH_Gcode\_data_\data_out\")

# ---- group: Draw Sequence
divide = DivideCurve(Curve=python_3.MOVE, Count=1000, Kinks=False)  # -> Points, Tangents, Parameters
item = ListItem(List=divide.Points, Index=Slider(470, range=0..1000), Wrap=True)
sph = Sphere(Base=item, Radius=5)

# ---- group: Build Plate
swatch = ColourSwatch(SwatchColor=RGB(187, 255, 255))  # disabled
python_5 = GhPythonScript()  # -> out, AREA; disabled
# ---------- python_5: Python ----------
import rhinoscriptsyntax as rs

AREA = rs.AddRectangle(rs.WorldXYPlane(), 1700, 1300)
# ---------- end python_5 ----------
preview_2 = CustomPreview(Geometry=python_5.AREA, Material=swatch)  # disabled

# ----
python_6 = GhPythonScript()  # -> out, a
# ---------- python_6: Python ----------
from gh_gcode import util

ut = util.Util()
reload(util)

src = [None, 1, 2, None, 3, None, None, 4, None, None, None]

src_pad = ut.padding_previous_value(src)


for i in xrange(len(src)):
    print(src[i], src_pad[i])
# ---------- end python_6 ----------
panel_15 = Panel(python_6.out)
